# Grasshopper definition assembled_speckle.gh (Grasshopper 1.0.7)
# plug-ins: eleFront, Speckle 2, treesloth01, Pufferfish, Rhino.Inside for Autodesk Revit, CORE.Toolbox.Grasshopper

# ---- group: BIMSC-PROJECT
# Send a message to James M. to add
# new materials. This list will be updated
# for all groups to have a common material
# library and common material names.
panel = Panel("ELEMENTAL MARS")
bimsc_project = Text(panel)

# ---- group: RECEIVE MATERIALS
# RECIEVE
# MATERIALS
panel_2 = Panel("https://macad.speckle.xyz/projects/4975f9f0a8/models/d59a568f9e")
receive = Receive(
    Stream=panel_2,
    AutoReceive=False,
    CurrentComponentState="expired",
    ExpandOutput=True,
    LastInfoMessage="James McBennett @ 03/02/2024 01:57:29: Materials 01-03-2024 (id:6ecf38526e)",
    ReceiveOnOpen=False,
    ReceivedCommitId="6ecf38526e",
    StreamWrapper="https://macad.speckle.xyz/streams/4975f9f0a8/branches/d59a568f9e",
    selectedKitName="Objects")  # -> Info, Materials
dso = DeconstructSpeckleObject(SpeckleObject=receive.Materials, selectedKitName="Objects")  # -> Inflatable, Insulation, Regolith, Soil, Steel

# ---- group: FLOOR_LEVELS
# Set your 'Project' name, your 'Group'
# number, your 'Volume' Location that
# connect wirelessly.
series = Series(Start=0, Step=1, Count="5")
expression = Expression(x=series, Expression="Format(\"{0:00}\", x)")
concat = Concatenate(FragmentA="L", FragmentB=expression)  # -> simplify(graft(Result))
floor_levels = Text(concat)

# ----
# filter terrain
# add actual units
panel_3 = Panel("TopoBrep")  # disabled
panel_4 = Panel("Contours")  # disabled
panel_5 = Panel("TopoMesh")  # disabled
panel_6 = Panel("BakedStudioMarsTopoMain")  # disabled
list = ValueList({"AngularDimension", "Arc", "Block", "Brep", "Circle", "Curve", "Dimension", "Ellipse", "Extrusion", "Hatch", "Leader", "Line", "LinearDimension", "Mesh", "Point", "Polyline", "Polysurface", "RadialDimension", "Surface", "Text", "TextDot"}, selected="Mesh")  # disabled
reflay = ReferenceByLayer(LayerName=panel_4, lightweight=False)  # disabled
reflay_2 = ReferenceByLayer(LayerName=panel_3, lightweight=False)  # disabled
reflay_3 = ReferenceByLayer(LayerName=panel_5, lightweight=False)  # disabled
reflay_4 = ReferenceByLayer(LayerName=panel_6, lightweight=False)  # disabled
mesh = MeshBrep(
    Brep=reflay_2,
    Settings={GridMaxCount=0, GridMinCount=16, JaggedSeams=False, MaxEdgeLength=0, MinEdgeLength=0.0001, MinTolerance=0, Refine=True, RefineAngle=0, RelativeTolerance=0.65, SimplePlanes=True, Tolerance=0})  # disabled
filtertype = FilterByType(ObjectType=list, Geometry=reflay_4, invertFilter=False, returnNulls=False)  # -> ExcludedGeometry, IncludedGeometry; disabled
brep = Brep(reflay_2)  # disabled
mesh_2 = Mesh(reflay_3)  # disabled
faceb = FaceBoundaries(Mesh=mesh_2)  # disabled
mesh_3 = Mesh(filtertype.IncludedGeometry)  # disabled
faceb_2 = FaceBoundaries(Mesh=mesh_3)  # disabled
boundary = BoundarySurfaces(Edges=faceb)  # disabled
boundary_2 = BoundarySurfaces(Edges=faceb_2)  # disabled
join = BrepJoin(Breps=boundary)  # -> Breps, Closed; disabled
join_2 = BrepJoin(Breps=boundary_2)  # -> Breps, Closed; disabled

# ---- group: BIMSC-ORIGINATOR
bimsc_originator = Text("G06")

# ---- group: WorksForBrepsAndMeshes
list_2 = ValueList({"Srf/Brep": 0, "Mesh": 1}, selected="Mesh")

# ---- group: BIMSC-VOLUME
bimsc_volume = Text("A4")

# ----
# UNITS
panel_7 = Panel("UnitsRawVolumes")
reflay_5 = ReferenceByLayer(LayerName=panel_7, lightweight=False)
volume = Volume(Geometry=reflay_5)  # -> Volume, Centroid
int = Integer(volume.Volume)
cset = CreateSet(List=int)  # -> Set, Map
cset_2 = CreateSet(List=cset.Map)  # -> Set, Map
mindex = MemberIndex(Set=cset.Map, Member=cset_2.Set)  # -> Index, Count
item = ListItem(List=reflay_5, Index=mindex.Index, Wrap=True)  # -> simplify(Item)
bang = ExplodeTree(Data=item)  # -> Branch0, Branch1
item_2 = ListItem(List=bang.Branch0, Index=0, Wrap=True)

volume_2 = Volume(Geometry=bang.Branch0)  # -> Volume, Centroid; disabled
group = Group()  # disabled
group_2 = Group()  # disabled
group_3 = Group()  # disabled

area = Area(Geometry=bang.Branch1)  # -> Area, Centroid
prox = Proximity3D(Points=area.Centroid, Group="1", MaxRadius="5")  # -> simplify(Links), Topology
clean = CleanTree(RemoveNulls=True, RemoveInvalid=True, RemoveEmpty=True, Tree=prox.Links)
dup_lines = CleanDuplicateLines(Lines=flatten(clean), Tolerance=0.01)  # -> Lines, Indices, Status
tstat = TreeStatistics(Tree=clean)  # -> Paths, Length, Count
split = SplitTree(Data=simplify(graft(bang.Branch1)), Masks=flatten(tstat.Paths))  # -> flatten(Positive), flatten(Negative)
dispatch = Dispatch(List=flatten(split.Positive), DispatchPattern=dup_lines.Status)  # -> ListA, ListB
item_3 = ListItem(List=split.Negative, Index="0", Wrap=True)

brep_2 = Brep(split.Negative)
volume_3 = Volume(Geometry=brep_2)  # -> Volume, Centroid
cull_i = CullIndex(List=volume_3.Centroid, Indices="0", Wrap=True)

# ---- group: units centroids
pt = Point(volume_3.Centroid)

# ----
group_4 = Group(Objects=flatten([group, group_2]))  # disabled

# ---- group: units centroids
pt_2 = Point(volume_2.Centroid)  # disabled

# ----
group_5 = Group()  # disabled
group_6 = Group()  # disabled

dispatch_2 = Dispatch(List=flatten(clean), DispatchPattern=dup_lines.Status)  # -> graft(ListA), ListB
renumber = RenumberPaths(Data=dispatch_2.ListA)
end = EndPoints(Curve=renumber)  # -> Start, End
pdecon = Deconstruct(Point=[end.Start, end.End])  # -> XComponent, YComponent, ZComponent
int_2 = Integer(pdecon.ZComponent)
bnd = Bounds(Numbers=int_2)
dedomain = DeconstructDomain(Domain=bnd)  # -> Start, End
equals = Equality(FirstNumber=int_2, SecondNumber=dedomain.Start)  # -> Equality, Inequality
subtraction = Subtraction(A=dedomain.Start, B=dedomain.End)
cull = CullPattern(List=[end.Start, end.End], CullPattern=equals.Equality)
division = Division(A=subtraction, B="2")
abs = Absolute(Value=subtraction)
Z = UnitZ(Factor=division)
wires = BrepWireframe(Brep=dispatch.ListA, Density=-1)
move = Move(Geometry=cull, Motion=Z)  # -> Geometry, Transform
project = Project(Geometry=wires, Plane=move.Geometry)  # -> simplify(Geometry), Transform

end_2 = EndPoints(Curve=project.Geometry)  # -> Start, End
multiplication = Multiplication(A=abs, B="2")
cullpt = CullDuplicates(Points=[end_2.Start, end_2.End], Tolerance=0.1, CullMode=3)  # -> Points, Indices, Valence
pline = PolyLine(Vertices=cullpt.Points, Closed=True)  # -> simplify(Polyline)
Z_2 = UnitZ(Factor=multiplication)
extr = Extrude(Base=pline, Direction=Z_2)
cap = CapHoles(Brep=extr)

# ---- group: Units_Buffer
debrep = DeconstructBrep(Brep=bang.Branch0)  # -> Faces, Edges, Vertices
area_2 = Area(Geometry=debrep.Faces)  # -> Area, Centroid
pdecon_2 = Deconstruct(Point=area_2.Centroid)  # -> XComponent, YComponent, ZComponent
int_3 = Integer(pdecon_2.ZComponent)
bnd_2 = Bounds(Numbers=int_3)
dedomain_2 = DeconstructDomain(Domain=bnd_2)  # -> Start, End
equals_2 = Equality(FirstNumber=int_3, SecondNumber=dedomain_2.Start)  # -> Equality, Inequality
cull_2 = CullPattern(List=area_2.Centroid, CullPattern=equals_2.Equality)  # -> simplify(List)
pln = Plane(flatten(cull_2))

# ---- group: Units_Support
debrep_2 = DeconstructBrep(Brep=cap)  # -> Faces, Edges, Vertices
area_3 = Area(Geometry=debrep_2.Faces)  # -> Area, Centroid
pdecon_3 = Deconstruct(Point=area_3.Centroid)  # -> XComponent, YComponent, ZComponent
int_4 = Integer(pdecon_3.ZComponent)
bnd_3 = Bounds(Numbers=int_4)
dedomain_3 = DeconstructDomain(Domain=bnd_3)  # -> Start, End
equals_3 = Equality(FirstNumber=int_4, SecondNumber=dedomain_3.Start)  # -> Equality, Inequality
cull_3 = CullPattern(List=area_3.Centroid, CullPattern=equals_3.Equality)  # -> simplify(List)
pln_2 = Plane(flatten(cull_3))

# ---- group: Units_Habi
debrep_3 = DeconstructBrep(Brep=split.Negative)  # -> Faces, Edges, Vertices
area_4 = Area(Geometry=debrep_3.Faces)  # -> Area, Centroid
pdecon_4 = Deconstruct(Point=area_4.Centroid)  # -> XComponent, YComponent, ZComponent
int_5 = Integer(pdecon_4.ZComponent)
bnd_4 = Bounds(Numbers=int_5)
dedomain_4 = DeconstructDomain(Domain=bnd_4)  # -> Start, End
equals_4 = Equality(FirstNumber=int_5, SecondNumber=dedomain_4.Start)  # -> Equality, Inequality
cull_4 = CullPattern(List=area_4.Centroid, CullPattern=equals_4.Equality)  # -> simplify(List)
pln_3 = Plane(flatten(cull_4))

# ----
reflay_6 = ReferenceByLayer(LayerName="Units", lightweight=False)

# ----
# 01 //Create Revit Materials from Rhino M Properties
trigger = Trigger(Interval=-1000, TimerInterval=1000, Target=[material, graphics])

# ----
# 02// Create New Unit Revit Family
trigger_2 = Trigger(Interval=-1000, TimerInterval=1000, Target=[new, famform, materials, active])

# ----
# The figures in the circles from the trigger component
# for the revit families to work have to be from left to right:
# a triangle (play), a pointer (mouse), and a key.
# //Send Topo Meshes to Revit
trigger_3 = Trigger(Interval=-1000, TimerInterval=1000, Target=topography)

# ----
# 03//Add Units to Revit
trigger_4 = Trigger(Interval=-1000, TimerInterval=1000, Target=[types, l_component_2, l_component, l_component_3])

# ---- group: Units_Buffer
brep_3 = Brep(Tree({0}: [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], {1}: [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]))

# ---- group: Units_Habi
brep_4 = Brep(Tree({0}: [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], {1}: [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]))

# ---- group: Units_Support
brep_5 = Brep(Tree({0}: [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], {1}: [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]))

# ----
# //Send block instances to Revit
listblockd = ListBlocksInDocument(fullName=True)
refblock = ReferenceBlockByName(BlockName=listblockd, getNestedBlocks=False, lightweight=False, DisableAutoUpdate=False)
item_4 = ListItem(List=refblock, Index=0, Wrap=True)
block_info = GetBlockInfo(Block=item_4)  # -> Name, Plane, Transform, BlockType, FilePath, Active
orient = Orient(Geometry=item_4, Source=block_info.Plane, Target=PlaneXY(0, 0, 0))  # -> Geometry, Transform
expblock = ExplodeBlock(Block=orient.Geometry, recursive=False)  # -> Name, Transform, Geometry

bang_2 = ExplodeTree(Data=orient.Geometry)  # -> Branch0, Branch1, Branch2
pt_3 = ConstructPoint(XCoordinate=0, YCoordinate=0, ZCoordinate=0)
geo = Geometry(bang_2.Branch2)
move2pt = MoveToPoint(Geometry=geo, PointA=pt_3, PointB=pln_3)  # -> Moved, Vector, Transform
block_info_2 = GetBlockInfo(Block=bang_2.Branch1)  # -> Name, Plane, Transform, BlockType, FilePath, Active

item_5 = ListItem(List=bang_2.Branch0, Index=0, Wrap=True)

# ----
# //Query materials' names using Elefront
geo_2 = Geometry(expblock.Geometry)
ef_att = EleFrontAttributes(Attributes=geo_2)
ef_layer = EleFrontLayer(Layer=ef_att)
ef_layer_2 = EleFrontLayer(Layer=ef_layer)

split_2 = TextSplit(Text=ef_layer, Separators="::")
item_6 = ListItem(List=split_2, Index=-1, Wrap=True)
concat_2 = Concatenate(FragmentA="M-", FragmentB=item_6)  # -> simplify(Result)
pshift = ShiftPaths(Data=concat_2, Offset=-1)

# ----
# 02// Create new component family
materials = QueryMaterials(Name=pshift)
add_link_to_revit_family_in_from_your_la = Panel("C:\Users\ARoncal\OneDrive - Thornton Tomasetti, Inc\__License Resources\Desktop\G06_studio_2024\Final\documentation\FTemplate_GEN_.rft")  # "Add Link to Revit Family in from your laptop. [Final / Documentation]"
famform = ComponentFamilyForm(Brep=graft(geo_2), Material=materials)
active = ActiveDocument()
shift = ShiftPaths(Data=famform, Offset=-1)
new = NewComponentFamily(
    Document=active,
    Template=add_link_to_revit_family_in_from_your_la,
    Overwrite=Toggle(True),
    Name=simplify(expblock.Name),
    Geometry=simplify(shift))

# ----
# 03//Add components to RH Planes
types = QueryTypes(Document=active, Kind=3, FamilyName=expblock.Name)
bang_3 = ExplodeTree()  # -> Branch0, Branch1, Branch2
l_component = AddComponentLocation(Document=active, Location=simplify(pln_3), Type=simplify(bang_3.Branch1), TrackingMode=2)
l_component_2 = AddComponentLocation(Document=active, Location=simplify(pln), Type=simplify(bang_3.Branch0), TrackingMode=2)
l_component_3 = AddComponentLocation(Document=active, Location=simplify(pln_2), Type=simplify(bang_3.Branch2), TrackingMode=2)

# ----
# Phasing
number_slider = Slider(7, range=1..7)  # disabled
series_2 = Series(Start=1, Step=1, Count=number_slider)  # disabled
item_7 = ListItem(List=series_2, Index=0, Wrap=True)  # -> Item, Item1, Item2, Item3, Item4, Item5, Item6; disabled

# ---- group: PHASE
num = Number(item_7.Item3)  # disabled

num_2 = Number(item_7.Item2)  # disabled

num_3 = Number(item_7.Item1)  # disabled

# PHASE 1 - NO HUMANS
# EDIT SITE MESH
num_4 = Number(item_7.Item)  # disabled

num_5 = Number(item_7.Item4)  # disabled

num_6 = Number(item_7.Item5)  # disabled

# PHASE 2 - HUMANS / MACHINE COLLABORATION
num_7 = Number(item_7.Item6)  # disabled

# ----
# WALLS
panel_8 = Panel("Wall")
reflay_7 = ReferenceByLayer(LayerName=panel_8, lightweight=False, DisableAutoUpdate=False)
panel_9 = Panel(reflay_7)
mesh_4 = MeshBrep(
    Brep=reflay_7,
    Settings={GridMaxCount=0, GridMinCount=16, JaggedSeams=False, MaxEdgeLength=0, MinEdgeLength=0.0001, MinTolerance=0, Refine=True, RefineAngle=0, RelativeTolerance=0.65, SimplePlanes=True, Tolerance=0})
brep_6 = Brep(reflay_7)
mjoin = MeshJoin(Meshes=mesh_4)
weld = WeldMesh(Mesh=mjoin, Angle=3.141592654)

panel_10 = Panel("https://macad.speckle.xyz/streams/4975f9f0a8/branches/site/04-community-site")
receive_2 = Receive(
    Stream=panel_10,
    AutoReceive=False,
    CurrentComponentState="expired",
    ExpandOutput=True,
    LastInfoMessage="James McBennett @ 03/01/2024 23:14:17: 2024 Mar-01 (id:9ec35295b2)",
    ReceiveOnOpen=False,
    ReceivedCommitId="9ec35295b2",
    StreamWrapper="https://macad.speckle.xyz/streams/4975f9f0a8/branches/site/04-community-site",
    selectedKitName="Objects")  # -> Info, CONTOURS, SOIL
item_8 = ListItem(List=flatten(receive_2.SOIL), Index=Slider(3, range=0..17), Wrap=True)
srf = Surface(<surface referenced from the Rhino model>)
bbox = BoundingBox(Content=srf, Plane=PlaneXY(0, 0, 0))  # -> Box, Box_2
volume_4 = Volume(Geometry=bbox.Box)  # -> Volume, Centroid
msphere = MeshSphere(Base=volume_4.Centroid, Radius="80", UCount="100", VCount="100")
mmx = MeshMesh(MeshA=item_8, MeshB=msphere)
msplit = MeshSplit(Mesh=item_8, Splitters=msphere)

# ----
# ROOFS
panel_11 = Panel("Roof")
reflay_8 = ReferenceByLayer(LayerName=panel_11, lightweight=False, DisableAutoUpdate=False)
panel_12 = Panel(reflay_8)
mesh_5 = Mesh(reflay_8)
faceb_3 = FaceBoundaries(Mesh=mesh_5)
boundary_3 = BoundarySurfaces(Edges=faceb_3)
join_3 = BrepJoin(Breps=boundary_3)  # -> Breps, Closed
mesh_6 = Mesh(reflay_8)

# ----
# TERRAIN
panel_13 = Panel("TopoMesh")
reflay_9 = ReferenceByLayer(LayerName=panel_13, lightweight=False, DisableAutoUpdate=False)
reflay_10 = ReferenceByLayer(LayerName="TopoBrep", lightweight=False, DisableAutoUpdate=False)
panel_14 = Panel([reflay_9, reflay_10])

# ----
# //Send topo meshes to Revit
number_slider_2 = Slider(9, range=0..10)
mesh_7 = Mesh(reflay_9)
unweld = UnweldMesh(Mesh=mesh_7, Angle=degrees(number_slider_2))
topography = AddTopographyMesh(Mesh=unweld, TrackingMode=2)  # disabled

# ----
# FLOORS
panel_15 = Panel("Floors")
reflay_11 = ReferenceByLayer(LayerName=panel_15, lightweight=False, DisableAutoUpdate=False)
panel_16 = Panel(reflay_11)
mesh_8 = MeshBrep(
    Brep=reflay_11,
    Settings={GridMaxCount=0, GridMinCount=16, JaggedSeams=False, MaxEdgeLength=0, MinEdgeLength=0.0001, MinTolerance=0, Refine=True, RefineAngle=0, RelativeTolerance=0.65, SimplePlanes=True, Tolerance=0})
brep_7 = Brep(reflay_11)
mjoin_2 = MeshJoin(Meshes=mesh_8)
weld_2 = WeldMesh(Mesh=mjoin_2, Angle=3.141592654)

reflay_12 = ReferenceByLayer(LayerName="Pods", lightweight=False, DisableAutoUpdate=False)
panel_17 = Panel(reflay_12)
mesh_9 = MeshBrep(
    Brep=reflay_12,
    Settings={GridMaxCount=0, GridMinCount=16, JaggedSeams=False, MaxEdgeLength=0, MinEdgeLength=0.0001, MinTolerance=0, Refine=True, RefineAngle=0, RelativeTolerance=0.65, SimplePlanes=True, Tolerance=0})
brep_8 = Brep(reflay_12)
mjoin_3 = MeshJoin(Meshes=mesh_9)
weld_3 = WeldMesh(Mesh=mjoin_3, Angle=3.141592654)

# ---- group: LEVEL
floor_levels_2 = Text(floor_levels)  # disabled

# ----
filter = StreamFilter(Gate=list_2, Stream0=reflay_10, Stream1=reflay_9)  # disabled
msplit_2 = MeshSplit(Mesh=filter, Splitters=msphere)  # disabled
number_slider_3 = Slider(1, range=0..1)  # disabled
item_9 = ListItem(List=msplit_2, Index=number_slider_3, Wrap=True)  # disabled
panel_18 = Panel("TERRAIN")  # disabled
panel_19 = Panel("soil")  # disabled
name = ExtendSpeckleObject(
    SpeckleObject=item_9,
    BIMSCPROJECT=bimsc_project,
    BIMSCORIGINATOR=bimsc_originator,
    BIMSCVOLUME=bimsc_volume,
    BIMSCLEVEL=floor_levels_2,
    BIMSCTYPE=panel_18,
    BIMSCMATERIAL=panel_19,
    RenderMaterial=dso.Soil,
    BIMSCPHASE=num_4,
    selectedKitName="Objects")  # -> flatten(ExtendedSpeckleObject); disabled

# ---- group: LEVEL
floor_levels_3 = Text(floor_levels)  # disabled

# ----
filter_2 = StreamFilter(Gate=list_2, Stream0=brep_7, Stream1=weld_2)  # disabled
panel_20 = Panel("FLOORS")  # disabled
panel_21 = Panel("Regolith")  # disabled
name_2 = ExtendSpeckleObject(
    SpeckleObject=filter_2,
    BIMSCPROJECT=bimsc_project,
    BIMSCORIGINATOR=bimsc_originator,
    BIMSCVOLUME=bimsc_volume,
    BIMSCLEVEL=floor_levels_3,
    BIMSCTYPE=panel_20,
    BIMSCMATERIAL=panel_21,
    RenderMaterial=dso.Regolith,
    BIMSCPHASE=num_3,
    selectedKitName="Objects")  # -> flatten(ExtendedSpeckleObject); disabled

# ---- group: LEVEL
floor_levels_4 = Text(floor_levels)  # disabled

# ----
filter_3 = StreamFilter(Gate=list_2, Stream0=brep_8, Stream1=weld_3)  # disabled
panel_22 = Panel("PODS")  # disabled
name_3 = ExtendSpeckleObject(
    SpeckleObject=filter_3,
    BIMSCPROJECT=bimsc_project,
    BIMSCORIGINATOR=bimsc_originator,
    BIMSCVOLUME=bimsc_volume,
    BIMSCLEVEL=floor_levels_4,
    BIMSCTYPE=panel_22,
    BIMSCMATERIAL=panel_21,
    RenderMaterial=dso.Regolith,
    BIMSCPHASE=num_2,
    selectedKitName="Objects")  # -> flatten(ExtendedSpeckleObject); disabled

# ---- group: LEVEL
floor_levels_5 = Text(floor_levels)  # disabled

floor_levels_6 = Text(floor_levels)  # disabled

txt = Text(Tree({0}: ["L00"], {1}: ["L04"]))  # disabled

# ----
filter_4 = StreamFilter(Gate=list_2, Stream0=join_3.Breps, Stream1=mesh_6)  # -> reverse(simplify(graft(Stream))); disabled
panel_23 = Panel("Inflatable")  # disabled
panel_24 = Panel("ROOF")  # disabled
name_4 = ExtendSpeckleObject(
    SpeckleObject=filter_4,
    BIMSCPROJECT=bimsc_project,
    BIMSCORIGINATOR=bimsc_originator,
    BIMSCVOLUME=bimsc_volume,
    BIMSCLEVEL=txt,
    BIMSCTYPE=panel_24,
    BIMSCMATERIAL=panel_23,
    RenderMaterial=dso.Inflatable,
    BIMSCPHASE=num_7,
    selectedKitName="Objects")  # disabled

# ---- group: LEVEL
txt_2 = Text(Tree({0}: ["L00"], {1}: ["L04"]))  # disabled

# ----
filter_5 = StreamFilter(Gate=list_2, Stream0=brep_6, Stream1=weld)  # -> reverse(simplify(graft(Stream))); disabled
panel_25 = Panel("WALLS")  # disabled
name_5 = ExtendSpeckleObject(
    SpeckleObject=filter_5,
    BIMSCPROJECT=bimsc_project,
    BIMSCORIGINATOR=bimsc_originator,
    BIMSCVOLUME=bimsc_volume,
    BIMSCLEVEL=txt_2,
    BIMSCTYPE=panel_25,
    BIMSCMATERIAL=panel_21,
    RenderMaterial=dso.Regolith,
    BIMSCPHASE=num_6,
    selectedKitName="Objects")  # disabled

# ---- group: LEVEL
floor_levels_7 = Text(floor_levels)  # disabled

# ----
number_slider_4 = Slider(0, range=0..1)  # disabled
item_10 = ListItem(List=msplit, Index=number_slider_4, Wrap=True)  # disabled
panel_26 = Panel("SITE")  # disabled
panel_27 = Panel("soil")  # disabled
name_6 = ExtendSpeckleObject(
    SpeckleObject=item_10,
    BIMSCPROJECT=bimsc_project,
    BIMSCORIGINATOR=bimsc_originator,
    BIMSCVOLUME=bimsc_volume,
    BIMSCLEVEL=floor_levels_7,
    BIMSCTYPE=panel_26,
    BIMSCMATERIAL=panel_27,
    RenderMaterial=dso.Soil,
    BIMSCPHASE=num_4,
    selectedKitName="Objects")  # -> flatten(ExtendedSpeckleObject); disabled

number_slider_5 = Slider(0.7, range=0..2.02)  # disabled
number_slider_6 = Slider(2, range=1..13)  # disabled
number_slider_7 = Slider(1.5, range=0..6.002)  # disabled
number_slider_8 = Slider(1.5, range=1..2)  # disabled
range = Range(Domain=number_slider_7, Steps=number_slider_8)  # disabled
range_2 = Range(Domain=Domain(0, 1), Steps=number_slider_8)  # disabled
graph = GraphMapper(range_2, x0=0, x1=1, y0=0, y1=1, container_name="Bezier", cpx=[0, 0.5185281634, 1, 1], cpy=[0, 0, 0.1436586976, 1])  # disabled
pt_4 = ConstructPoint(XCoordinate=0, YCoordinate=0, ZCoordinate=range)  # disabled
panel_28 = Panel("0.5*pi")  # disabled
dom = ConstructDomain(DomainStart=number_slider_6, DomainEnd=number_slider_5)  # disabled
bnd_5 = Bounds(Numbers=graph)  # disabled
prot = RotatePlane(Plane=pt_4, Angle=panel_28)  # disabled
remap = RemapNumbers(Value=graph, Source=bnd_5, Target=dom)  # -> Mapped, Clipped; disabled
cir = Circle(Plane=pt_4, Radius=remap.Mapped)  # disabled
item_11 = ListItem(List=cir, Index=0, Wrap=True)  # disabled
number_slider_9 = Slider(4, range=0..50)  # disabled
area_5 = Area(Geometry=item_11)  # -> Area, Centroid; disabled
number_slider_10 = Slider(0.01, range=0..1)  # disabled
range_3 = Range(Domain=Domain(0, 1), Steps=number_slider_9)  # disabled
panel_29 = Panel("1")  # disabled
panel_30 = Panel("0")  # disabled
shatter = Shatter(Curve=reparameterize(graft(cir)), Parameters=range_3)  # disabled
subtraction_2 = Subtraction(A=panel_29, B=number_slider_10)  # disabled
merge = Merge(Data1=panel_30, Data2=number_slider_10, Data3=subtraction_2, Data4=panel_29)  # disabled
consec = ConsecutiveDomains(Numbers=merge, Additive=invert(True))  # disabled
panel_31 = Panel(merge)  # disabled
subcrv = SubCurve(BaseCurve=reparameterize(graft(shatter)), Domain=consec)  # disabled
panel_32 = Panel("""0
2""")  # disabled
panel_33 = Panel(consec)  # disabled
cull_i_2 = CullIndex(List=subcrv, Indices=panel_32, Wrap=True)  # -> simplify(List); disabled
item_12 = ListItem(List=subcrv, Index=panel_32, Wrap=True)  # disabled
pshift_2 = ShiftPaths(Data=cull_i_2, Offset=-1)  # disabled
flip = FlipMatrix(Data=pshift_2)  # disabled
midpt = CurveMiddle(Curve=flip)  # disabled
loft = Loft(Curves=cir, Options={Adjust=False, Closed=False, LoftEnds=0, LoftSimp=0, LoftType=0, Rebuild=10, Refit=0.01})  # disabled
number_slider_11 = Slider(0.1, range=0..10)  # disabled
number_slider_12 = Slider(0.11, range=0..1)  # disabled
pshift_3 = ShiftPaths(Data=item_12, Offset=-1)  # disabled
graph_2 = GraphMapper(range_2, x0=0, x1=1, y0=0, y1=1, container_name="Bezier", cpx=[0, 0.25, 0.75, 1], cpy=[0, 0.25, 0.75, 1])  # disabled
join_4 = JoinCurves(Curves=pshift_3, Preserve=False)  # disabled
brep_cp = BrepClosestPoint(Point=midpt, Brep=loft)  # -> Point, Normal, Distance; disabled
dom_2 = ConstructDomain(DomainStart=number_slider_11, DomainEnd=number_slider_12)  # disabled
flip_2 = FlipMatrix(Data=join_4)  # disabled
bnd_6 = Bounds(Numbers=graph_2)  # disabled
remap_2 = RemapNumbers(Value=graph_2, Source=bnd_6, Target=dom_2)  # -> Mapped, Clipped; disabled
amp = Amplitude(Vector=brep_cp.Normal, Amplitude=remap_2.Mapped)  # disabled
rev = Reverse(Vector=amp)  # disabled
end_3 = EndPoints(Curve=flip)  # -> Start, End; disabled
move_2 = Move(Geometry=midpt, Motion=rev)  # -> Geometry, Transform; disabled
arc = Arc3Pt(PointA=end_3.Start, PointB=move_2.Geometry, PointC=end_3.End)  # -> Arc, Plane, Radius; disabled
item_13 = ListItem(List=arc.Arc, Index=0, Wrap=True)  # disabled
project_2 = Project(Geometry=item_13, Plane=PlaneXY(0, 0, 0))  # -> Geometry, Transform; disabled
panel_34 = Panel("0")  # disabled
panel_35 = Panel("0.01")  # disabled
loft_opt = LoftOptions(Closed=False, Adjust=False, Rebuild=0, Refit=panel_35, Type=0)  # disabled
replace = ReplaceItems(List=arc.Arc, Item=project_2.Geometry, Indices=panel_34, Wrap=False)  # disabled
loft_2 = Loft(Curves=flip_2, Options=loft_opt)  # disabled
loft_3 = Loft(Curves=replace, Options=loft_opt)  # disabled
entwine = Entwine(Branch00=loft_3, Branch01=loft_2, FlattenInputs=True)  # disabled
number_slider_13 = Slider(0.01, range=0..1)  # disabled
swatch = ColourSwatch(SwatchColor=RGB(255, 255, 255))  # disabled
swatch_2 = ColourSwatch(SwatchColor=RGBA(107, 107, 107, 206))  # disabled
brep_9 = Brep(item_2)  # disabled
merge_2 = Merge(Data1=swatch_2, Data2=swatch)  # -> simplify(graft(Result)); disabled
python = GhPythonScript(S=entwine, D=number_slider_13)  # -> simplify(a); inputs S: Brep; disabled
# ---------- python: Python ----------
import rhinoscriptsyntax as rs

a = rs.OffsetSurface(S, D, None, False, True)
# ---------- end python ----------
flatten = FlattenTree(Tree=python, Path="{0}")  # disabled

number_slider_14 = Slider(0.1, range=0..10)  # disabled
panel_36 = Panel("-1")  # disabled
Z_3 = UnitZ(Factor=expr("-x", number_slider_14))  # disabled
item_14 = ListItem(List=cir, Index=panel_36, Wrap=True)  # disabled
extr_2 = Extrude(Base=item_14, Direction=Z_3)  # disabled
cap_2 = CapHoles(Brep=extr_2)  # disabled

item_15 = ListItem(List=brep_9, Index=0, Wrap=True)  # disabled

volume_5 = Volume(Geometry=item_15)  # -> Volume, Centroid; disabled
move2pt_2 = MoveToPoint(Geometry=flatten, PointA=area_5.Centroid, PointB=graft(volume_5.Centroid))  # -> simplify(Moved), Vector, Transform; disabled
lng = ListLength(List=move2pt_2.Moved)  # disabled
graft = GraftTree(Tree=volume_5.Centroid, IncludeEmptyLists=True, IncludeNullItems=True)  # -> simplify(Tree); disabled
group_7 = Group(Objects=move2pt_2.Moved)  # disabled
split_3 = SplitList(List=move2pt_2.Moved, Index=expr("x/2", lng))  # -> flatten(ListA), flatten(ListB); disabled
mirror = Mirror(Geometry=group_7, Plane=graft)  # -> Geometry, Transform; disabled
ungroup = Ungroup(Group=mirror.Geometry)  # disabled
move2pt_3 = MoveToPoint(Geometry=cap_2, PointA=area_5.Centroid, PointB=graft(volume_5.Centroid))  # -> Moved, Vector, Transform; disabled
split_4 = SplitList(List=ungroup, Index=expr("x/2", lng))  # -> flatten(ListA), flatten(ListB); disabled
entwine_2 = Entwine(Branch00=split_3.ListA, Branch01=split_3.ListB, FlattenInputs=True)  # -> simplify(Result); disabled
entwine_3 = Entwine(Branch00=split_4.ListA, Branch01=split_4.ListB, FlattenInputs=True)  # -> simplify(Result); disabled
merge_3 = Merge(Data1=entwine_2, Data2=entwine_3)  # disabled

data = Data([split_3.ListB, split_4.ListB])  # disabled
data_2 = Data([split_3.ListA, split_4.ListA])  # disabled
qrmesh = QuadRemesh(Mesh=data_2, Settings={aqc=True, as=50, dhe=True, gci=0, null=False, pme=0, sa=0, tqc=2000})  # -> graft(QuadResult); disabled
qrmesh_2 = QuadRemesh(Mesh=data, Settings={aqc=True, as=50, dhe=True, gci=0, null=False, pme=0, sa=0, tqc=2000})  # disabled

# ---- group: unit centroid
pt_5 = Point(volume_5.Centroid)  # disabled

# ----
group_8 = Group(Objects=qrmesh)  # disabled
group_9 = Group(Objects=qrmesh_2)  # disabled
group_10 = Group(Objects=flatten([group_9, group_5]))  # disabled
move2pt_4 = MoveToPoint(Geometry=move2pt_3.Moved, PointA=pt_5, PointB=pt_2)  # -> flatten(Moved), Vector, Transform; disabled
move2pt_5 = MoveToPoint(Geometry=qrmesh_2, PointA=pt_5, PointB=graft(pt_2))  # -> flatten(Moved), Vector, Transform; disabled
move2pt_6 = MoveToPoint(Geometry=qrmesh, PointA=pt_5, PointB=pt_2)  # -> flatten(Moved), Vector, Transform; disabled
merge_4 = Merge(Data1=move2pt_4.Moved, Data2=move2pt_5.Moved)  # disabled

number_slider_15 = Slider(1.2, range=0..2.02)  # disabled
number_slider_16 = Slider(3.9, range=1..13)  # disabled
number_slider_17 = Slider(1.5, range=1..2)  # disabled
number_slider_18 = Slider(1.5, range=0..6.002)  # disabled
range_4 = Range(Domain=number_slider_18, Steps=number_slider_17)  # disabled
range_5 = Range(Domain=Domain(0, 1), Steps=number_slider_17)  # disabled
graph_3 = GraphMapper(range_5, x0=0, x1=1, y0=0, y1=1, container_name="Bezier", cpx=[0, 0.5185281634, 1, 1], cpy=[0, 0, 0.1436586976, 1])  # disabled
pt_6 = ConstructPoint(XCoordinate=0, YCoordinate=0, ZCoordinate=range_4)  # disabled
panel_37 = Panel("0.5*pi")  # disabled
dom_3 = ConstructDomain(DomainStart=number_slider_16, DomainEnd=number_slider_15)  # disabled
bnd_7 = Bounds(Numbers=graph_3)  # disabled
prot_2 = RotatePlane(Plane=pt_6, Angle=panel_37)  # disabled
remap_3 = RemapNumbers(Value=graph_3, Source=bnd_7, Target=dom_3)  # -> Mapped, Clipped; disabled
number_slider_19 = Slider(0.01, range=0..1)  # disabled
cir_2 = Circle(Plane=prot_2, Radius=remap_3.Mapped)  # disabled
item_16 = ListItem(List=cir_2, Index=0, Wrap=True)  # disabled
number_slider_20 = Slider(8, range=0..50)  # disabled
panel_38 = Panel("1")  # disabled
area_6 = Area(Geometry=item_16)  # -> Area, Centroid; disabled
panel_39 = Panel("0")  # disabled
subtraction_3 = Subtraction(A=panel_38, B=number_slider_19)  # disabled
range_6 = Range(Domain=Domain(0, 1), Steps=number_slider_20)  # disabled
merge_5 = Merge(Data1=panel_39, Data2=number_slider_19, Data3=subtraction_3, Data4=panel_38)  # disabled
shatter_2 = Shatter(Curve=reparameterize(graft(cir_2)), Parameters=range_6)  # disabled
consec_2 = ConsecutiveDomains(Numbers=merge_5, Additive=invert(True))  # disabled
panel_40 = Panel(merge_5)  # disabled
subcrv_2 = SubCurve(BaseCurve=reparameterize(graft(shatter_2)), Domain=consec_2)  # disabled
panel_41 = Panel("""0
2""")  # disabled
panel_42 = Panel(consec_2)  # disabled
cull_i_3 = CullIndex(List=subcrv_2, Indices=panel_41, Wrap=True)  # -> simplify(List); disabled
item_17 = ListItem(List=subcrv_2, Index=panel_41, Wrap=True)  # disabled
pshift_4 = ShiftPaths(Data=cull_i_3, Offset=-1)  # disabled
flip_3 = FlipMatrix(Data=pshift_4)  # disabled
midpt_2 = CurveMiddle(Curve=flip_3)  # disabled
loft_4 = Loft(Curves=cir_2, Options={Adjust=False, Closed=False, LoftEnds=0, LoftSimp=0, LoftType=0, Rebuild=10, Refit=0.01})  # disabled
number_slider_21 = Slider(0.1, range=0..10)  # disabled
number_slider_22 = Slider(0.11, range=0..1)  # disabled
pshift_5 = ShiftPaths(Data=item_17, Offset=-1)  # disabled
graph_4 = GraphMapper(range_5, x0=0, x1=1, y0=0, y1=1, container_name="Bezier", cpx=[0, 0.25, 0.75, 1], cpy=[0, 0.25, 0.75, 1])  # disabled
join_5 = JoinCurves(Curves=pshift_5, Preserve=False)  # disabled
brep_cp_2 = BrepClosestPoint(Point=midpt_2, Brep=loft_4)  # -> Point, Normal, Distance; disabled
dom_4 = ConstructDomain(DomainStart=number_slider_21, DomainEnd=number_slider_22)  # disabled
flip_4 = FlipMatrix(Data=join_5)  # disabled
bnd_8 = Bounds(Numbers=graph_4)  # disabled
remap_4 = RemapNumbers(Value=graph_4, Source=bnd_8, Target=dom_4)  # -> Mapped, Clipped; disabled
amp_2 = Amplitude(Vector=brep_cp_2.Normal, Amplitude=remap_4.Mapped)  # disabled
rev_2 = Reverse(Vector=amp_2)  # disabled
end_4 = EndPoints(Curve=flip_3)  # -> Start, End; disabled
move_3 = Move(Geometry=midpt_2, Motion=rev_2)  # -> Geometry, Transform; disabled
arc_2 = Arc3Pt(PointA=end_4.Start, PointB=move_3.Geometry, PointC=end_4.End)  # -> Arc, Plane, Radius; disabled
item_18 = ListItem(List=arc_2.Arc, Index=0, Wrap=True)  # disabled
project_3 = Project(Geometry=item_18, Plane=PlaneXY(0, 0, 0))  # -> Geometry, Transform; disabled
panel_43 = Panel("0")  # disabled
panel_44 = Panel("0.01")  # disabled
loft_opt_2 = LoftOptions(Closed=False, Adjust=False, Rebuild=0, Refit=panel_44, Type=0)  # disabled
replace_2 = ReplaceItems(List=arc_2.Arc, Item=project_3.Geometry, Indices=panel_43, Wrap=False)  # disabled
loft_5 = Loft(Curves=flip_4, Options=loft_opt_2)  # disabled
loft_6 = Loft(Curves=replace_2, Options=loft_opt_2)  # disabled
entwine_4 = Entwine(Branch00=loft_6, Branch01=loft_5, FlattenInputs=True)  # disabled
number_slider_23 = Slider(0.01, range=0..1)  # disabled
swatch_3 = ColourSwatch(SwatchColor=RGB(255, 255, 255))  # disabled
swatch_4 = ColourSwatch(SwatchColor=RGBA(189, 189, 189, 206))  # disabled
merge_6 = Merge(Data1=swatch_4, Data2=swatch_3)  # -> simplify(graft(Result)); disabled
python_2 = GhPythonScript(S=entwine_4, D=number_slider_23)  # -> simplify(a); inputs S: Brep; disabled; same code as python
brep_10 = Brep(item_3)  # disabled
volume_6 = Volume(Geometry=brep_10)  # -> Volume, Centroid; disabled
flatten_2 = FlattenTree(Tree=python_2, Path="{0}")  # disabled
move2pt_7 = MoveToPoint(Geometry=flatten_2, PointA=area_6.Centroid, PointB=graft(volume_6.Centroid))  # -> simplify(Moved), Vector, Transform; disabled
lng_2 = ListLength(List=move2pt_7.Moved)  # disabled
graft_2 = GraftTree(Tree=volume_6.Centroid, IncludeEmptyLists=True, IncludeNullItems=True)  # -> simplify(Tree); disabled
group_11 = Group(Objects=move2pt_7.Moved)  # disabled
split_5 = SplitList(List=move2pt_7.Moved, Index=expr("x/2", lng_2))  # -> flatten(ListA), flatten(ListB); disabled
mirror_2 = Mirror(Geometry=group_11, Plane=graft_2)  # -> Geometry, Transform; disabled
ungroup_2 = Ungroup(Group=mirror_2.Geometry)  # disabled
entwine_5 = Entwine(Branch00=split_5.ListA, Branch01=split_5.ListB, FlattenInputs=True)  # -> simplify(Result); disabled
split_6 = SplitList(List=ungroup_2, Index=expr("x/2", lng_2))  # -> flatten(ListA), flatten(ListB); disabled
entwine_6 = Entwine(Branch00=split_6.ListA, Branch01=split_6.ListB, FlattenInputs=True)  # -> simplify(Result); disabled
merge_7 = Merge(Data1=entwine_5, Data2=entwine_6)  # disabled

number_slider_24 = Slider(0.1, range=0..10)  # disabled
panel_45 = Panel("-1")  # disabled
Z_4 = UnitZ(Factor=expr("-x", number_slider_24))  # disabled
item_19 = ListItem(List=cir_2, Index=panel_45, Wrap=True)  # disabled
extr_3 = Extrude(Base=item_19, Direction=Z_4)  # disabled
cap_3 = CapHoles(Brep=extr_3)  # disabled

move2pt_8 = MoveToPoint(Geometry=cap_3, PointA=area_6.Centroid, PointB=graft(volume_6.Centroid))  # -> Moved, Vector, Transform; disabled

data_3 = Data([split_5.ListB, split_6.ListB])  # disabled
data_4 = Data([split_5.ListA, split_6.ListA])  # disabled

# ---- group: unit centroid
pt_7 = Point(volume_6.Centroid)  # disabled

# ----
debrep_4 = DeconstructBrep(Brep=brep_10)  # -> Faces, Edges, Vertices; disabled
area_7 = Area(Geometry=debrep_4.Faces)  # -> Area, Centroid; disabled
panel_46 = Panel("""0
3""")  # disabled
item_20 = ListItem(List=flatten(area_7.Centroid), Index=panel_46, Wrap=True)  # disabled
panel_47 = Panel("22.5")  # disabled
rotate = Rotate(Geometry=item_20, Angle=degrees(panel_47), Plane=pt_7)  # -> Geometry, Transform; disabled
number_slider_25 = Slider(2, range=0..10)  # disabled
number_slider_26 = Slider(0, range=0..10)  # disabled
ln = Line(StartPoint=rotate.Geometry, EndPoint=pt_7)  # disabled
ext = ExtendCurve(Curve=ln, Type=0, Start=number_slider_25, End=number_slider_26)  # disabled
panel_48 = Panel("0.5")  # disabled
number_slider_27 = Slider(0.7, range=0..1)  # disabled
pframe = PerpFrame(Curve=reparameterize(ext), Parameter=panel_48)  # -> graft(Frame); disabled
pipe = Pipe(Curve=ext, Radius=1, Caps=0)  # disabled
scale_nu = ScaleNU(Geometry=pipe, Plane=pframe, ScaleX=1, ScaleY=number_slider_27, ScaleZ=1)  # -> Geometry, Transform; disabled
panel_49 = Panel(pframe)  # disabled
cap_4 = CapHoles(Brep=scale_nu.Geometry)  # disabled
mesh_10 = Mesh(cap_4)  # disabled
number_slider_28 = Slider(0, range=0..100)  # disabled
msplit_3 = MeshSplit(Splitters=flatten(mesh_10))  # disabled
item_21 = ListItem(List=msplit_3, Index=number_slider_28, Wrap=True)  # disabled

move2pt_9 = MoveToPoint(Geometry=data_3, PointA=pt_7, PointB=graft(pt))  # -> flatten(Moved), Vector, Transform; disabled
move2pt_10 = MoveToPoint(Geometry=data_4, PointA=pt_7, PointB=pt)  # -> flatten(Moved), Vector, Transform; disabled
move2pt_11 = MoveToPoint(PointA=pt_7, PointB=pt)  # -> flatten(Moved), Vector, Transform; disabled
merge_8 = Merge(Data1=move2pt_10.Moved, Data2=move2pt_9.Moved)  # disabled

number_slider_29 = Slider(1.2, range=0..2.02)  # disabled
number_slider_30 = Slider(4.2, range=1..13)  # disabled
number_slider_31 = Slider(3.7, range=0..6.002)  # disabled
number_slider_32 = Slider(1.5, range=1..2)  # disabled
range_7 = Range(Domain=number_slider_31, Steps=number_slider_32)  # disabled
range_8 = Range(Domain=Domain(0, 1), Steps=number_slider_32)  # disabled
graph_5 = GraphMapper(range_8, x0=0, x1=1, y0=0, y1=1, container_name="Bezier", cpx=[0, 0.5185281634, 1, 1], cpy=[0, 0, 0.1436586976, 1])  # disabled
pt_8 = ConstructPoint(XCoordinate=0, YCoordinate=0, ZCoordinate=range_7)  # disabled
panel_50 = Panel("0.5*pi")  # disabled
dom_5 = ConstructDomain(DomainStart=number_slider_30, DomainEnd=number_slider_29)  # disabled
bnd_9 = Bounds(Numbers=graph_5)  # disabled
prot_3 = RotatePlane(Plane=pt_8, Angle=panel_50)  # disabled
remap_5 = RemapNumbers(Value=graph_5, Source=bnd_9, Target=dom_5)  # -> Mapped, Clipped; disabled
cir_3 = Circle(Plane=prot_3, Radius=remap_5.Mapped)  # disabled
item_22 = ListItem(List=cir_3, Index=0, Wrap=True)  # disabled
number_slider_33 = Slider(8, range=0..50)  # disabled
area_8 = Area(Geometry=item_22)  # -> Area, Centroid; disabled
number_slider_34 = Slider(0.01, range=0..1)  # disabled
range_9 = Range(Domain=Domain(0, 1), Steps=number_slider_33)  # disabled
panel_51 = Panel("1")  # disabled
panel_52 = Panel("0")  # disabled
shatter_3 = Shatter(Curve=reparameterize(graft(cir_3)), Parameters=range_9)  # disabled
subtraction_4 = Subtraction(A=panel_51, B=number_slider_34)  # disabled
merge_9 = Merge(Data1=panel_52, Data2=number_slider_34, Data3=subtraction_4, Data4=panel_51)  # disabled
consec_3 = ConsecutiveDomains(Numbers=merge_9, Additive=invert(True))  # disabled
panel_53 = Panel(merge_9)  # disabled
subcrv_3 = SubCurve(BaseCurve=reparameterize(graft(shatter_3)), Domain=consec_3)  # disabled
panel_54 = Panel("""0
2""")  # disabled
panel_55 = Panel(consec_3)  # disabled
cull_i_4 = CullIndex(List=subcrv_3, Indices=panel_54, Wrap=True)  # -> simplify(List); disabled
item_23 = ListItem(List=subcrv_3, Index=panel_54, Wrap=True)  # disabled
pshift_6 = ShiftPaths(Data=cull_i_4, Offset=-1)  # disabled
flip_5 = FlipMatrix(Data=pshift_6)  # disabled
midpt_3 = CurveMiddle(Curve=flip_5)  # disabled
loft_7 = Loft(Curves=cir_3, Options={Adjust=False, Closed=False, LoftEnds=0, LoftSimp=0, LoftType=0, Rebuild=10, Refit=0.01})  # disabled
number_slider_35 = Slider(0.1, range=0..10)  # disabled
number_slider_36 = Slider(0.11, range=0..1)  # disabled
pshift_7 = ShiftPaths(Data=item_23, Offset=-1)  # disabled
graph_6 = GraphMapper(range_8, x0=0, x1=1, y0=0, y1=1, container_name="Bezier", cpx=[0, 0.25, 0.75, 1], cpy=[0, 0.25, 0.75, 1])  # disabled
join_6 = JoinCurves(Curves=pshift_7, Preserve=False)  # disabled
brep_cp_3 = BrepClosestPoint(Point=midpt_3, Brep=loft_7)  # -> Point, Normal, Distance; disabled
dom_6 = ConstructDomain(DomainStart=number_slider_35, DomainEnd=number_slider_36)  # disabled
flip_6 = FlipMatrix(Data=join_6)  # disabled
bnd_10 = Bounds(Numbers=graph_6)  # disabled
remap_6 = RemapNumbers(Value=graph_6, Source=bnd_10, Target=dom_6)  # -> Mapped, Clipped; disabled
amp_3 = Amplitude(Vector=brep_cp_3.Normal, Amplitude=remap_6.Mapped)  # disabled
rev_3 = Reverse(Vector=amp_3)  # disabled
end_5 = EndPoints(Curve=flip_5)  # -> Start, End; disabled
move_4 = Move(Geometry=midpt_3, Motion=rev_3)  # -> Geometry, Transform; disabled
arc_3 = Arc3Pt(PointA=end_5.Start, PointB=move_4.Geometry, PointC=end_5.End)  # -> Arc, Plane, Radius; disabled
item_24 = ListItem(List=arc_3.Arc, Index=0, Wrap=True)  # disabled
project_4 = Project(Geometry=item_24, Plane=PlaneXY(0, 0, 0))  # -> Geometry, Transform; disabled
panel_56 = Panel("0")  # disabled
panel_57 = Panel("0.01")  # disabled
loft_opt_3 = LoftOptions(Closed=False, Adjust=False, Rebuild=0, Refit=panel_57, Type=0)  # disabled
replace_3 = ReplaceItems(List=arc_3.Arc, Item=project_4.Geometry, Indices=panel_56, Wrap=False)  # disabled
loft_8 = Loft(Curves=flip_6, Options=loft_opt_3)  # disabled
loft_9 = Loft(Curves=replace_3, Options=loft_opt_3)  # disabled
entwine_7 = Entwine(Branch00=loft_9, Branch01=loft_8, FlattenInputs=True)  # disabled
number_slider_37 = Slider(0.01, range=0..1)  # disabled
swatch_5 = ColourSwatch(SwatchColor=RGB(255, 255, 255))  # disabled
swatch_6 = ColourSwatch(SwatchColor=RGBA(107, 107, 107, 206))  # disabled
merge_10 = Merge(Data1=swatch_6, Data2=swatch_5)  # -> simplify(graft(Result)); disabled
python_3 = GhPythonScript(S=entwine_7, D=number_slider_37)  # -> simplify(a); inputs S: Brep; disabled; same code as python
brep_11 = Brep(cap)  # disabled
flatten_3 = FlattenTree(Tree=python_3, Path="{0}")  # disabled

number_slider_38 = Slider(0.1, range=0..10)  # disabled
panel_58 = Panel("-1")  # disabled
Z_5 = UnitZ(Factor=expr("-x", number_slider_38))  # disabled
item_25 = ListItem(List=cir_3, Index=panel_58, Wrap=True)  # disabled
extr_4 = Extrude(Base=item_25, Direction=Z_5)  # disabled
cap_5 = CapHoles(Brep=extr_4)  # disabled

item_26 = ListItem(List=flatten(brep_11), Index=0, Wrap=True)  # disabled

volume_7 = Volume(Geometry=item_26)  # -> Volume, Centroid; disabled
move2pt_12 = MoveToPoint(Geometry=flatten_3, PointA=area_8.Centroid, PointB=graft(volume_7.Centroid))  # -> simplify(Moved), Vector, Transform; disabled
lng_3 = ListLength(List=move2pt_12.Moved)  # disabled
graft_3 = GraftTree(Tree=volume_7.Centroid, IncludeEmptyLists=True, IncludeNullItems=True)  # -> simplify(Tree); disabled
group_12 = Group(Objects=move2pt_12.Moved)  # disabled
split_7 = SplitList(List=move2pt_12.Moved, Index=expr("x/2", lng_3))  # -> flatten(ListA), flatten(ListB); disabled
mirror_3 = Mirror(Geometry=group_12, Plane=graft_3)  # -> Geometry, Transform; disabled
ungroup_3 = Ungroup(Group=mirror_3.Geometry)  # disabled
move2pt_13 = MoveToPoint(Geometry=cap_5, PointA=area_8.Centroid, PointB=graft(volume_7.Centroid))  # -> Moved, Vector, Transform; disabled
entwine_8 = Entwine(Branch00=split_7.ListA, Branch01=split_7.ListB, FlattenInputs=True)  # -> simplify(Result); disabled
split_8 = SplitList(List=ungroup_3, Index=expr("x/2", lng_3))  # -> flatten(ListA), flatten(ListB); disabled
entwine_9 = Entwine(Branch00=split_8.ListA, Branch01=split_8.ListB, FlattenInputs=True)  # -> simplify(Result); disabled
merge_11 = Merge(Data1=entwine_8, Data2=entwine_9)  # disabled

volume_8 = Volume(Geometry=brep_11)  # -> Volume, Centroid; disabled
data_5 = Data([split_7.ListB, split_8.ListB])  # disabled
data_6 = Data([split_7.ListA, split_8.ListA])  # disabled
qrmesh_3 = QuadRemesh(Mesh=data_6, Settings={aqc=True, as=50, dhe=True, gci=0, null=False, pme=0, sa=0, tqc=2000})  # -> graft(QuadResult); disabled
qrmesh_4 = QuadRemesh(Mesh=data_5, Settings={aqc=True, as=50, dhe=True, gci=0, null=False, pme=0, sa=0, tqc=2000})  # disabled

# ---- group: units centroids
pt_9 = Point(flatten(volume_8.Centroid))  # disabled

# ---- group: unit centroid
pt_10 = Point(volume_7.Centroid)  # disabled

# ----
group_13 = Group(Objects=qrmesh_4)  # disabled
group_14 = Group(Objects=qrmesh_3)  # disabled
group_15 = Group(Objects=flatten([group_13, group_6]))  # disabled
move2pt_14 = MoveToPoint(Geometry=qrmesh_4, PointA=pt_10, PointB=graft(pt_9))  # -> flatten(Moved), Vector, Transform; disabled
move2pt_15 = MoveToPoint(Geometry=qrmesh_3, PointA=pt_10, PointB=pt_9)  # -> flatten(Moved), Vector, Transform; disabled
move2pt_16 = MoveToPoint(Geometry=[move2pt_13.Moved, qrmesh_4], PointA=pt_10, PointB=pt_9)  # -> flatten(Moved), Vector, Transform; disabled
merge_12 = Merge(Data1=move2pt_14.Moved, Data2=move2pt_16.Moved)  # disabled

filter_6 = StreamFilter(Gate=list_2, Stream1=[move2pt_15.Moved, move2pt_11.Moved, move2pt_6.Moved])
panel_59 = Panel("Inflatable")  # disabled
panel_60 = Panel("UNITS INFLATABLE")  # disabled
name_7 = ExtendSpeckleObject(
    SpeckleObject=filter_6,
    BIMSCPROJECT=bimsc_project,
    BIMSCORIGINATOR=bimsc_originator,
    BIMSCVOLUME=bimsc_volume,
    BIMSCLEVEL=floor_levels_6,
    BIMSCTYPE=panel_60,
    BIMSCMATERIAL=panel_59,
    RenderMaterial=dso.Insulation,
    BIMSCPHASE=num_5,
    selectedKitName="Objects")  # -> flatten(ExtendedSpeckleObject); disabled

# ----
# UNITS
filter_7 = StreamFilter(Gate=list_2, Stream1=[merge_12, merge_8, merge_4])
panel_61 = Panel("UNIT STRUCTURE")  # disabled
panel_62 = Panel("Steel")  # disabled
name_8 = ExtendSpeckleObject(
    SpeckleObject=filter_7,
    BIMSCPROJECT=bimsc_project,
    BIMSCORIGINATOR=bimsc_originator,
    BIMSCVOLUME=bimsc_volume,
    BIMSCLEVEL=floor_levels_5,
    BIMSCTYPE=panel_61,
    BIMSCMATERIAL=panel_62,
    RenderMaterial=dso.Steel,
    BIMSCPHASE=num,
    selectedKitName="Objects")  # -> flatten(ExtendedSpeckleObject); disabled

# ----
# 01 //Create Revit materials from Rhino M Properties
cset_3 = CreateSet(List=flatten(pshift))  # -> Set, Map
material = AddMaterial(Name=cset_3.Set, TrackingMode=2)

# ---- group: MaterialProperties
python_4 = GhPythonScript(Mname=cset_3.Set)  # -> out, Pvalue, Pname
# ---------- python_4: Python ----------
__author__ = "hesham.shawqy"
__version__ = "2024.02.25"

import rhinoscriptsyntax as rs
import Rhino.DocObjects as rd
import Rhino as rh

def get_material_properties(Mname):
    # Get the active Rhino document
    doc = rh.RhinoDoc.ActiveDoc
    
    # Search for the material by name
    material_index = doc.Materials.Find(Mname, True)
    if material_index < 0:
        print("Material not found.")
        return None
    
    # Retrieve the material object
    material = doc.Materials[material_index]
    
    # Extract material properties
    properties = {
        "DiffuseColor": material.DiffuseColor,
        "Transparency": material.Transparency,
        # Add more properties as needed
    }
    
    return properties

Pname = []
Pvalue = []
material_properties = get_material_properties(Mname)
if material_properties:
    for prop, value in material_properties.items():
        Pvalue.append(value)
        Pname.append(prop)
# ---------- end python_4 ----------

# ----
item_27 = ListItem(List=simplify(python_4.Pvalue), Index=0, Wrap=True)  # -> Item, Item1
graphics = MaterialGraphics(
    Material=simplify(graft(material)),
    Color=item_27.Item,
    Transparency=item_27.Item1,
    ForegroundPatternCutPatterns=<geometry referenced from the Revit model>)  # -> Material, UseRenderAppearance, Color, Transparency, SurfacePatternsForegroundPattern, SurfacePatternsForegroundColor, CutPatternsForegroundPattern, CutPatternsForegroundColor

# ----
# SEND TO SPLECKLE STREAMS
# G6_STUDIO_MAIN_MODEL
# https://macad.speckle.xyz/streams/677b44128b
# G06_test_Unreal
# https://macad.speckle.xyz/streams/5e4e4e4563
# g06 wip branch
# https://macad.speckle.xyz/streams/4975f9f0a8/branches/wip%2Fg06
# g06 shared branch
# https://macad.speckle.xyz/streams/4975f9f0a8/branches/shared%2Fg06
panel_63 = Panel("G06_AssembledModel_V4")  # disabled
cso = CreateSpeckleObject(
    ROOF=name_4,
    WALL=name_5,
    FLOORS=name_2,
    PODS=name_3,
    UNITSINFLATABLES=name_7,
    UNITSTRUCTURE=name_8,
    TERRAIN=name,
    SITE_A4=name_6,
    selectedKitName="Objects")  # disabled

# ----
# Always Leave Send Component Unplugged
# in the stream input before closing and
# saving this gh file
send = Send(
    Message=panel_63,
    D=cso,
    AutoSend=False,
    BaseId="81f03236b71b13f63b781442c5bde320",
    CurrentComponentState="up_to_date",
    KitName="Objects",
    OutputWrappers="https://macad.speckle.xyz\t677b44128b\tcb70638a05",
    UseDefaultCache=True,
    selectedKitName="Objects")  # disabled

rec = DataRecorder(send, DataLimit=-10, RecordData=True)  # disabled
panel_64 = Panel(rec)  # disabled
