# Grasshopper definition units_detail_Paula.gh (Grasshopper 1.0.7)
# plug-ins: Speckle 2, treesloth01, Human, Pufferfish, eleFront, Bifocals

panel = Panel("https://macad.speckle.xyz/streams/0f1c84ad9c/commits/c4616ae012")
receive = Receive(
    Stream=panel,
    AutoReceive=False,
    CurrentComponentState="up_to_date",
    ExpandOutput=True,
    LastInfoMessage="Andres Roncal @ 02/27/2024 02:15:02: Sent 72 elements from Rhino. (id:c4616ae012)",
    ReceiveOnOpen=False,
    ReceivedCommitId="c4616ae012",
    StreamWrapper="https://macad.speckle.xyz/streams/0f1c84ad9c/commits/c4616ae012",
    selectedKitName="Objects")  # -> Info, CollectionType, Elements, Name
dso = DeconstructSpeckleObject(SpeckleObject=receive.Elements, selectedKitName="Objects")  # -> CollectionType, DisplayStyle, Elements, Name, Visible
dso_2 = DeconstructSpeckleObject(SpeckleObject=dso.Elements, selectedKitName="Objects")  # -> CollectionType, DisplayStyle, Elements, Name, Visible
dso_3 = DeconstructSpeckleObject(SpeckleObject=dso.DisplayStyle, selectedKitName="Objects")  # -> Color, Linetype, Lineweight, Name, Units

panel_2 = Panel("https://macad.speckle.xyz/streams/4975f9f0a8/commits/9ec35295b2")
receive_2 = Receive(
    Stream=panel_2,
    AutoReceive=False,
    CurrentComponentState="expired",
    ExpandOutput=True,
    ReceiveOnOpen=False,
    ReceivedCommitId="9ec35295b2",
    StreamWrapper="https://macad.speckle.xyz/streams/4975f9f0a8/commits/9ec35295b2",
    selectedKitName="Objects")  # -> Info, CONTOURS, SOIL
mesh = Mesh(receive_2.SOIL)  # disabled
dso_4 = DeconstructSpeckleObject(SpeckleObject=receive.Elements, selectedKitName="Objects")  # -> CollectionType, DisplayStyle, Elements, Name, Visible
panel_3 = Panel(receive_2.SOIL)
reflay = ReferenceByLayer(LayerName="UnitsRawVolumes", lightweight=False)

volume = Volume(Geometry=reflay)  # -> Volume, Centroid
int = Integer(volume.Volume)
cset = CreateSet(List=int)  # -> Set, Map
cset_2 = CreateSet(List=cset.Map)  # -> Set, Map
mindex = MemberIndex(Set=cset.Map, Member=cset_2.Set)  # -> Index, Count
item = ListItem(List=reflay, Index=mindex.Index, Wrap=True)  # -> simplify(Item)
bang = ExplodeTree(Data=item)  # -> Branch0, Branch1

area = Area(Geometry=bang.Branch1)  # -> Area, Centroid
prox = Proximity3D(Points=area.Centroid, Group="1", MaxRadius="5")  # -> simplify(Links), Topology
clean = CleanTree(RemoveNulls=True, RemoveInvalid=True, RemoveEmpty=True, Tree=prox.Links)
tstat = TreeStatistics(Tree=clean)  # -> Paths, Length, Count
split = SplitTree(Data=simplify(graft(bang.Branch1)), Masks=flatten(tstat.Paths))  # -> flatten(Positive), flatten(Negative)

# ----
# HABIT
number_slider = Slider(1.5, range=1..2)
item_2 = ListItem(List=bang.Branch0, Index=0, Wrap=True)
range = Range(Domain=Slider(1.5, range=0..6.002), Steps=number_slider)
range_2 = Range(Domain=Domain(0, 1), Steps=number_slider)
graph = GraphMapper(range_2, x0=0, x1=1, y0=0, y1=1, container_name="Bezier", cpx=[0, 0.5185281634, 1, 1], cpy=[0, 0, 0.1436586976, 1])
pt = ConstructPoint(XCoordinate=0, YCoordinate=0, ZCoordinate=range)
dom = ConstructDomain(DomainStart=Slider(3.9, range=1..13), DomainEnd=Slider(1.2, range=0..2.02))
bnd = Bounds(Numbers=graph)
prot = RotatePlane(Plane=pt, Angle="0.5*pi")
remap = RemapNumbers(Value=graph, Source=bnd, Target=dom)  # -> Mapped, Clipped
number_slider_2 = Slider(0.01, range=0..1)
cir = Circle(Plane=prot, Radius=remap.Mapped)
item_3 = ListItem(List=cir, Index=0, Wrap=True)
item_4 = ListItem(List=split.Negative, Index=0, Wrap=True)
area_2 = Area(Geometry=item_3)  # -> Area, Centroid
range_3 = Range(Domain=Domain(0, 1), Steps=Slider(8, range=0..50))
subtraction = Subtraction(A="1", B=number_slider_2)
merge = Merge(Data1="0", Data2=number_slider_2, Data3=subtraction, Data4="1")
shatter = Shatter(Curve=reparameterize(graft(cir)), Parameters=range_3)
consec = ConsecutiveDomains(Numbers=merge, Additive=invert(True))
panel_4 = Panel(merge)
subcrv = SubCurve(BaseCurve=reparameterize(graft(shatter)), Domain=consec)
panel_5 = Panel("""0
2""")
panel_6 = Panel(consec)
cull_i = CullIndex(List=subcrv, Indices=panel_5, Wrap=True)  # -> simplify(List)
item_5 = ListItem(List=subcrv, Index=panel_5, Wrap=True)
pshift = ShiftPaths(Data=cull_i, Offset=-1)
flip = FlipMatrix(Data=pshift)
midpt = CurveMiddle(Curve=flip)
loft = Loft(Curves=cir, Options={Adjust=False, Closed=False, LoftEnds=0, LoftSimp=0, LoftType=0, Rebuild=10, Refit=0.01})
pshift_2 = ShiftPaths(Data=item_5, Offset=-1)

renumber = RenumberPaths(Data=clean)
end = EndPoints(Curve=renumber)  # -> Start, End
pdecon = Deconstruct(Point=[end.Start, end.End])  # -> XComponent, YComponent, ZComponent
int_2 = Integer(pdecon.ZComponent)
bnd_2 = Bounds(Numbers=int_2)
dedomain = DeconstructDomain(Domain=bnd_2)  # -> Start, End
equals = Equality(FirstNumber=int_2, SecondNumber=dedomain.Start)  # -> Equality, Inequality
subtraction_2 = Subtraction(A=dedomain.Start, B=dedomain.End)
cull = CullPattern(List=[end.Start, end.End], CullPattern=equals.Equality)
division = Division(A=subtraction_2, B="2")
abs = Absolute(Value=subtraction_2)
Z = UnitZ(Factor=division)
wires = BrepWireframe(Brep=split.Positive, Density=-1)
move = Move(Geometry=cull, Motion=Z)  # -> Geometry, Transform
project = Project(Geometry=wires, Plane=move.Geometry)  # -> simplify(Geometry), Transform

graph_2 = GraphMapper(range_2, x0=0, x1=1, y0=0, y1=1, container_name="Bezier", cpx=[0, 0.25, 0.75, 1], cpy=[0, 0.25, 0.75, 1])
join = JoinCurves(Curves=pshift_2, Preserve=False)
brep_cp = BrepClosestPoint(Point=midpt, Brep=loft)  # -> Point, Normal, Distance
dom_2 = ConstructDomain(DomainStart=Slider(0.1, range=0..10), DomainEnd=Slider(0.11, range=0..1))
flip_2 = FlipMatrix(Data=join)
bnd_3 = Bounds(Numbers=graph_2)
remap_2 = RemapNumbers(Value=graph_2, Source=bnd_3, Target=dom_2)  # -> Mapped, Clipped
amp = Amplitude(Vector=brep_cp.Normal, Amplitude=remap_2.Mapped)
rev = Reverse(Vector=amp)
end_2 = EndPoints(Curve=flip)  # -> Start, End
move_2 = Move(Geometry=midpt, Motion=rev)  # -> Geometry, Transform
arc = Arc3Pt(PointA=end_2.Start, PointB=move_2.Geometry, PointC=end_2.End)  # -> Arc, Plane, Radius
item_6 = ListItem(List=arc.Arc, Index=0, Wrap=True)
project_2 = Project(Geometry=item_6, Plane=PlaneXY(0, 0, 0))  # -> Geometry, Transform
loft_opt = LoftOptions(Closed=False, Adjust=False, Rebuild=0, Refit="0.01", Type=0)
replace = ReplaceItems(List=arc.Arc, Item=project_2.Geometry, Indices="0", Wrap=False)

Z_2 = UnitZ(Factor=expr("-x", Slider(0.1, range=0..10)))
item_7 = ListItem(List=cir, Index="-1", Wrap=True)
extr = Extrude(Base=item_7, Direction=Z_2)
cap = CapHoles(Brep=extr)

end_3 = EndPoints(Curve=project.Geometry)  # -> Start, End
multiplication = Multiplication(A=abs, B="2")
cullpt = CullDuplicates(Points=[end_3.Start, end_3.End], Tolerance=0.1, CullMode=3)  # -> Points, Indices, Valence
pline = PolyLine(Vertices=cullpt.Points, Closed=True)  # -> simplify(Polyline)
Z_3 = UnitZ(Factor=multiplication)
extr_2 = Extrude(Base=pline, Direction=Z_3)
cap_2 = CapHoles(Brep=extr_2)

loft_2 = Loft(Curves=replace, Options=loft_opt)
loft_3 = Loft(Curves=flip_2, Options=loft_opt)

item_8 = ListItem(List=end_2.End, Index=0, Wrap=True)  # -> flatten(Item)
crv_cp = CurveClosestPoint(Point=item_8, Curve=item_7)  # -> flatten(Point), Parameter, Distance
debrep = DeconstructBrep(Brep=loft_2)  # -> Faces, Edges, Vertices
midpt_2 = CurveMiddle(Curve=debrep.Edges)
avr = Average(Input=crv_cp.Point)
pdecon_2 = Deconstruct(Point=midpt_2)  # -> XComponent, YComponent, ZComponent
vec2pt = Vector2Pt(PointA=avr, PointB=crv_cp.Point, Unitize=False)  # -> Vector, Length
amp_2 = Amplitude(Vector=vec2pt.Vector, Amplitude=Slider(0.1, range=0..0.1))
smaller = SmallerThan(FirstNumber=pdecon_2.ZComponent, SecondNumber="0.1")  # -> SmallerThan, OrEqualTo
larger = LargerThan(FirstNumber=pdecon_2.ZComponent, SecondNumber="0.1")  # -> LargerThan, OrEqualTo
move_3 = Move(Geometry=crv_cp.Point, Motion=amp_2)  # -> Geometry, Transform
cull_2 = CullPattern(List=midpt_2, CullPattern=smaller.SmallerThan)
ln = Line(StartPoint=crv_cp.Point, EndPoint=move_3.Geometry)
panel_7 = Panel("""0
3""")
flatten = FlattenTree(Tree=cull_2, Path="{0}")
panel_8 = Panel("""1
2""")
neg = Negative(Value=Slider(2.81, range=0..5))
avr_2 = Average(Input=flatten(flatten))
item_9 = ListItem(List=flatten, Index=panel_7, Wrap=True)
item_10 = ListItem(List=flatten, Index=panel_8, Wrap=True)
Z_4 = UnitZ(Factor=neg)
neg_2 = Negative(Value=Slider(0.15, range=0..5))
move_4 = Move(Geometry=avr, Motion=Z_4)  # -> Geometry, Transform
ln_2 = Line(StartPoint=avr_2, EndPoint=item_10)
ln_3 = Line(StartPoint=avr_2, EndPoint=item_9)
Z_5 = UnitZ(Factor=neg_2)
pframe = PerpFrame(Curve=simplify(ln_2), Parameter="0.5")  # -> graft(Frame)
ln_4 = Line(StartPoint=move_4.Geometry, EndPoint=avr)
pframe_2 = PerpFrame(Curve=simplify(ln_3), Parameter="0.5")  # -> graft(Frame)
ext = ExtendCurve(Curve=ln_2, Type="0", Start="0", End="1")
move_5 = Move(Geometry=avr, Motion=Z_5)  # -> Geometry, Transform
ext_2 = ExtendCurve(Curve=ln_3, Type="0", Start="0", End="1")
circle = CircleCNR(Center=move_4.Geometry, Normal=Vector(0, 0, 1), Radius=Slider(5, range=0..10))
ln_5 = Line(StartPoint=move_5.Geometry, EndPoint=avr)
pipe = Pipe(Curve=ext_2, Radius="1", Caps=0)
number_slider_3 = Slider(0.75, range=0..1)
avr_3 = Average(Input=item_8)
boundary = BoundarySurfaces(Edges=circle)
offcrv = OffsetCurve(Curve=item_7, Plane=PlaneXY(0, 0, 0), Distance=Slider(0.05, range=0..0.1), BothSides=0, Kinks=0, CapType=1)
circle_2 = CircleCNR(Center=move_5.Geometry, Normal=Vector(0, 0, 1), Radius=Slider(5, range=0..10))
merge_2 = Merge(Data1=offcrv, Data2=item_7)  # -> flatten(Result)
boundary_2 = BoundarySurfaces(Edges=circle_2)
srf = Surface(flatten(loft_2))
mirror = Mirror(Geometry=srf, Plane=avr_3)  # -> Geometry, Transform
scale_nu = ScaleNU(Geometry=pipe, Plane=pframe_2, ScaleX=Slider(1.1, range=0..1.1), ScaleY=Slider(0.88, range=0..1), ScaleZ=1)  # -> flatten(Geometry), Transform
pipe_2 = Pipe(Curve=ext, Radius="1", Caps=0)

entwine = Entwine(Branch00=loft_2, Branch01=loft_3, FlattenInputs=True)
merge_3 = Merge(Data1=ColourSwatch(SwatchColor=RGBA(189, 189, 189, 206)), Data2=ColourSwatch(SwatchColor=RGB(255, 255, 255)))  # -> simplify(graft(Result))
python = GhPythonScript(S=entwine, D=Slider(0.01, range=0..1))  # -> simplify(a); inputs S: Brep
# ---------- python: Python ----------
import rhinoscriptsyntax as rs

a = rs.OffsetSurface(S, D, None, False, True)
# ---------- end python ----------
brep = Brep(item_4)
volume_2 = Volume(Geometry=brep)  # -> Volume, Centroid
flatten_2 = FlattenTree(Tree=python, Path="{0}")
move2pt = MoveToPoint(Geometry=flatten_2, PointA=area_2.Centroid, PointB=graft(volume_2.Centroid))  # -> simplify(Moved), Vector, Transform
lng = ListLength(List=move2pt.Moved)
graft = GraftTree(Tree=volume_2.Centroid, IncludeEmptyLists=True, IncludeNullItems=True)  # -> simplify(Tree)
group = Group(Objects=move2pt.Moved)
split_2 = SplitList(List=move2pt.Moved, Index=expr("x/2", lng))  # -> flatten(ListA), flatten(ListB)
mirror_2 = Mirror(Geometry=group, Plane=graft)  # -> Geometry, Transform
ungroup = Ungroup(Group=mirror_2.Geometry)
move2pt_2 = MoveToPoint(Geometry=cap, PointA=area_2.Centroid, PointB=graft(volume_2.Centroid))  # -> Moved, Vector, Transform
entwine_2 = Entwine(Branch00=split_2.ListA, Branch01=split_2.ListB, FlattenInputs=True)  # -> simplify(Result)
split_3 = SplitList(List=ungroup, Index=expr("x/2", lng))  # -> flatten(ListA), flatten(ListB)
entwine_3 = Entwine(Branch00=split_3.ListA, Branch01=split_3.ListB, FlattenInputs=True)  # -> simplify(Result)
merge_4 = Merge(Data1=entwine_2, Data2=entwine_3)
previewmat = CustomPreviewMaterials(Geometry=move2pt_2.Moved, DiffuseColor=RGB(255, 255, 255))
previewmat_2 = CustomPreviewMaterials(Geometry=merge_4, DiffuseColor=merge_3)

bbx = BrepBrep(BrepA=mirror.Geometry, BrepB=boundary)  # -> Curves, Points
loft_4 = Loft(Curves=merge_2, Options={Adjust=False, Closed=False, LoftEnds=0, LoftSimp=0, LoftType=0, Rebuild=10, Refit=0.01})
bbx_2 = BrepBrep(BrepA=srf, BrepB=boundary_2)  # -> Curves, Points
cap_3 = CapHoles(Brep=pipe_2)
cap_4 = CapHoles(Brep=scale_nu.Geometry)
number_slider_4 = Slider(0.2, range=0..0.2)
end_4 = EndPoints(Curve=bbx_2.Curves)  # -> flatten(Start), End
end_5 = EndPoints(Curve=bbx.Curves)  # -> flatten(Start), End
number_slider_5 = Slider(0.14, range=0..0.2)
merge_5 = Merge(Data1=cap_4, Data2=cap_3)  # -> flatten(Result)
pline_2 = PolyLine(Vertices=end_4.Start, Closed=True)
pline_3 = PolyLine(Vertices=end_5.Start, Closed=True)
Z_6 = UnitZ(Factor=number_slider_4)
multiplication_2 = Multiplication(A=number_slider_4, B="-0.5")
offset = OffsetCurve(Curve=pline_2, Distance="-0.1", Corners=1)
offset_2 = OffsetCurve(Curve=pline_3, Distance="-0.1", Corners=1)
splitmul = SplitBrepMultiple(Brep=srf, Cutters=merge_5)
Z_7 = UnitZ(Factor=multiplication_2)
bbx_3 = BrepBrep(BrepA=cap_4, BrepB=srf)  # -> Curves, Points
bbx_4 = BrepBrep(BrepA=cap_3, BrepB=srf)  # -> Curves, Points
Y = UnitY(Factor=1)
boundary_3 = BoundarySurfaces(Edges=offset)
X = UnitX(Factor=1)
boundary_4 = BoundarySurfaces(Edges=offset_2)
Z_8 = UnitZ(Factor=Slider(0.05, range=0.05..0.1))
extr_3 = Extrude(Base=loft_4, Direction=Z_6)
area_3 = Area(Geometry=splitmul)  # -> Area, Centroid
smaller_2 = SmallerThan(FirstNumber=flatten(area_3.Area), SecondNumber=Slider(3, range=0..10))  # -> SmallerThan, OrEqualTo
contour = Contour(Shape=boundary_3, Point=Point(0, 0, 0), Direction=Y, Distance=number_slider_5)
contour_2 = Contour(Shape=boundary_3, Point=Point(0, 0, 0), Direction=X, Distance=number_slider_5)
number_slider_6 = Slider(0.02, range=0..0.1)
Z_9 = UnitZ(Factor=number_slider_6)
neg_3 = Negative(Value=Z_9)
move_6 = Move(Geometry=contour, Motion=neg_3)  # -> Geometry, Transform
pipe_3 = Pipe(Curve=move_6.Geometry, Radius=number_slider_6, Caps=0)
pipe_4 = Pipe(Curve=contour_2, Radius=number_slider_6, Caps=0)
extr_4 = Extrude(Base=boundary_4, Direction=Z_8)
cull_3 = CullPattern(List=flatten(splitmul), CullPattern=smaller_2.SmallerThan)
merge_6 = Merge(Data1=pipe_3, Data2=pipe_4)
move_7 = Move(Geometry=extr_3, Motion=Z_7)  # -> Geometry, Transform
item_11 = ListItem(List=splitmul, Index=0, Wrap=True)
pipe_5 = Pipe(Curve=bbx_3.Curves, Radius=Slider(0.05, range=0..0.1), Caps=0)
pipe_6 = Pipe(Curve=bbx_4.Curves, Radius=Slider(0.05, range=0..0.1), Caps=0)
pipe_7 = Pipe(Curve=ln, Radius=Slider(0.05, range=0..0.1), Caps=0)
boundary_5 = BoundarySurfaces(Edges=item_7)
srf_2 = Surface(loft_3)
offsrf = OffsetSurface(Surface=srf_2, Distance=Slider(0.05, range=0..0.1), BothSides=0, CreateSolid=True)
# Layers
offset_3 = OffsetSurface(Surface=item_11, Distance=Slider(0.1, range=0..0.2), Retrim=True)
offset_4 = OffsetSurface(Surface=offset_3, Distance=Slider(0.1, range=0..0.2), Retrim=True)
entwine_4 = Entwine(
    Branch00=extr_4,
    Branch01=merge_6,
    Branch02=cull_3,
    Branch03=pipe_5,
    Branch04=pipe_6,
    Branch05=boundary_5,
    Branch06=move_7.Geometry,
    Branch07=pipe_7,
    Branch08=offsrf,
    FlattenInputs=True)
panel_9 = Panel("https://macad.speckle.xyz/streams/5e4e4e4563/branches/24.02.27-class")  # disabled

# ----
# SUPPORT
number_slider_7 = Slider(1.5, range=1..2)
range_4 = Range(Domain=Slider(1.5, range=0..6.002), Steps=number_slider_7)
range_5 = Range(Domain=Domain(0, 1), Steps=number_slider_7)
graph_3 = GraphMapper(range_5, x0=0, x1=1, y0=0, y1=1, container_name="Bezier", cpx=[0, 0.5185281634, 1, 1], cpy=[0, 0, 0.1436586976, 1])
pt_2 = ConstructPoint(XCoordinate=0, YCoordinate=0, ZCoordinate=range_4)
dom_3 = ConstructDomain(DomainStart=Slider(2, range=1..13), DomainEnd=Slider(0.7, range=0..2.02))
bnd_4 = Bounds(Numbers=graph_3)
prot_2 = RotatePlane(Plane=pt_2, Angle="0.5*pi")
remap_3 = RemapNumbers(Value=graph_3, Source=bnd_4, Target=dom_3)  # -> Mapped, Clipped
cir_2 = Circle(Plane=pt_2, Radius=remap_3.Mapped)
item_12 = ListItem(List=cir_2, Index=0, Wrap=True)
area_4 = Area(Geometry=item_12)  # -> Area, Centroid
number_slider_8 = Slider(0.01, range=0..1)
range_6 = Range(Domain=Domain(0, 1), Steps=Slider(4, range=0..50))
shatter_2 = Shatter(Curve=reparameterize(graft(cir_2)), Parameters=range_6)
subtraction_3 = Subtraction(A="1", B=number_slider_8)
merge_7 = Merge(Data1="0", Data2=number_slider_8, Data3=subtraction_3, Data4="1")
consec_2 = ConsecutiveDomains(Numbers=merge_7, Additive=invert(True))
panel_10 = Panel(merge_7)
subcrv_2 = SubCurve(BaseCurve=reparameterize(graft(shatter_2)), Domain=consec_2)
panel_11 = Panel("""0
2""")
panel_12 = Panel(consec_2)
cull_i_2 = CullIndex(List=subcrv_2, Indices=panel_11, Wrap=True)  # -> simplify(List)
item_13 = ListItem(List=subcrv_2, Index=panel_11, Wrap=True)
pshift_3 = ShiftPaths(Data=cull_i_2, Offset=-1)
flip_3 = FlipMatrix(Data=pshift_3)
midpt_3 = CurveMiddle(Curve=flip_3)
loft_5 = Loft(Curves=cir_2, Options={Adjust=False, Closed=False, LoftEnds=0, LoftSimp=0, LoftType=0, Rebuild=10, Refit=0.01})
pshift_4 = ShiftPaths(Data=item_13, Offset=-1)
graph_4 = GraphMapper(range_5, x0=0, x1=1, y0=0, y1=1, container_name="Bezier", cpx=[0, 0.25, 0.75, 1], cpy=[0, 0.25, 0.75, 1])
join_2 = JoinCurves(Curves=pshift_4, Preserve=False)
brep_cp_2 = BrepClosestPoint(Point=midpt_3, Brep=loft_5)  # -> Point, Normal, Distance
dom_4 = ConstructDomain(DomainStart=Slider(0.1, range=0..10), DomainEnd=Slider(0.11, range=0..1))
flip_4 = FlipMatrix(Data=join_2)
bnd_5 = Bounds(Numbers=graph_4)
remap_4 = RemapNumbers(Value=graph_4, Source=bnd_5, Target=dom_4)  # -> Mapped, Clipped
amp_3 = Amplitude(Vector=brep_cp_2.Normal, Amplitude=remap_4.Mapped)
rev_2 = Reverse(Vector=amp_3)
end_6 = EndPoints(Curve=flip_3)  # -> Start, End
move_8 = Move(Geometry=midpt_3, Motion=rev_2)  # -> Geometry, Transform
arc_2 = Arc3Pt(PointA=end_6.Start, PointB=move_8.Geometry, PointC=end_6.End)  # -> Arc, Plane, Radius
item_14 = ListItem(List=arc_2.Arc, Index=0, Wrap=True)
project_3 = Project(Geometry=item_14, Plane=PlaneXY(0, 0, 0))  # -> Geometry, Transform
loft_opt_2 = LoftOptions(Closed=False, Adjust=False, Rebuild=0, Refit="0.01", Type=0)
replace_2 = ReplaceItems(List=arc_2.Arc, Item=project_3.Geometry, Indices="0", Wrap=False)
loft_6 = Loft(Curves=flip_4, Options=loft_opt_2)
loft_7 = Loft(Curves=replace_2, Options=loft_opt_2)
entwine_5 = Entwine(Branch00=loft_7, Branch01=loft_6, FlattenInputs=True)
brep_2 = Brep(item_2)
merge_8 = Merge(Data1=ColourSwatch(SwatchColor=RGBA(107, 107, 107, 206)), Data2=ColourSwatch(SwatchColor=RGB(255, 255, 255)))  # -> simplify(graft(Result))
python_2 = GhPythonScript(S=entwine_5, D=Slider(0.01, range=0..1))  # -> simplify(a); inputs S: Brep; same code as python
flatten_3 = FlattenTree(Tree=python_2, Path="{0}")

Z_10 = UnitZ(Factor=expr("-x", Slider(0.1, range=0..10)))
item_15 = ListItem(List=cir_2, Index="-1", Wrap=True)
extr_5 = Extrude(Base=item_15, Direction=Z_10)
cap_5 = CapHoles(Brep=extr_5)

item_16 = ListItem(List=brep_2, Index=0, Wrap=True)

volume_3 = Volume(Geometry=item_16)  # -> Volume, Centroid
move2pt_3 = MoveToPoint(Geometry=flatten_3, PointA=area_4.Centroid, PointB=graft(volume_3.Centroid))  # -> simplify(Moved), Vector, Transform
lng_2 = ListLength(List=move2pt_3.Moved)
graft_2 = GraftTree(Tree=volume_3.Centroid, IncludeEmptyLists=True, IncludeNullItems=True)  # -> simplify(Tree)
group_2 = Group(Objects=move2pt_3.Moved)
split_4 = SplitList(List=move2pt_3.Moved, Index=expr("x/2", lng_2))  # -> flatten(ListA), flatten(ListB)
mirror_3 = Mirror(Geometry=group_2, Plane=graft_2)  # -> Geometry, Transform
ungroup_2 = Ungroup(Group=mirror_3.Geometry)
move2pt_4 = MoveToPoint(Geometry=cap_5, PointA=area_4.Centroid, PointB=graft(volume_3.Centroid))  # -> Moved, Vector, Transform
entwine_6 = Entwine(Branch00=split_4.ListA, Branch01=split_4.ListB, FlattenInputs=True)  # -> simplify(Result)
split_5 = SplitList(List=ungroup_2, Index=expr("x/2", lng_2))  # -> flatten(ListA), flatten(ListB)
entwine_7 = Entwine(Branch00=split_5.ListA, Branch01=split_5.ListB, FlattenInputs=True)  # -> simplify(Result)
merge_9 = Merge(Data1=entwine_6, Data2=entwine_7)
previewmat_3 = CustomPreviewMaterials(Geometry=merge_9, DiffuseColor=merge_3)
previewmat_4 = CustomPreviewMaterials(Geometry=move2pt_4.Moved, DiffuseColor=RGB(255, 255, 255))

# ----
# BUFFER
number_slider_9 = Slider(3.7, range=0..6.002)
number_slider_10 = Slider(1.5, range=1..2)
range_7 = Range(Domain=number_slider_9, Steps=number_slider_10)
range_8 = Range(Domain=Domain(0, 1), Steps=number_slider_10)
graph_5 = GraphMapper(range_8, x0=0, x1=1, y0=0, y1=1, container_name="Bezier", cpx=[0, 0.5185281634, 1, 1], cpy=[0, 0, 0.1436586976, 1])
pt_3 = ConstructPoint(XCoordinate=0, YCoordinate=0, ZCoordinate=range_7)
dom_5 = ConstructDomain(DomainStart=Slider(4.2, range=1..13), DomainEnd=Slider(1.2, range=0..2.02))
bnd_6 = Bounds(Numbers=graph_5)
prot_3 = RotatePlane(Plane=pt_3, Angle="0.5*pi")
remap_5 = RemapNumbers(Value=graph_5, Source=bnd_6, Target=dom_5)  # -> Mapped, Clipped
cir_3 = Circle(Plane=prot_3, Radius=remap_5.Mapped)
item_17 = ListItem(List=cir_3, Index=0, Wrap=True)
area_5 = Area(Geometry=item_17)  # -> Area, Centroid
number_slider_11 = Slider(0.01, range=0..1)
range_9 = Range(Domain=Domain(0, 1), Steps=Slider(8, range=0..50))
shatter_3 = Shatter(Curve=reparameterize(graft(cir_3)), Parameters=range_9)
subtraction_4 = Subtraction(A="1", B=number_slider_11)
merge_10 = Merge(Data1="0", Data2=number_slider_11, Data3=subtraction_4, Data4="1")
consec_3 = ConsecutiveDomains(Numbers=merge_10, Additive=invert(True))
panel_13 = Panel(merge_10)
subcrv_3 = SubCurve(BaseCurve=reparameterize(graft(shatter_3)), Domain=consec_3)
panel_14 = Panel("""0
2""")
panel_15 = Panel(consec_3)
cull_i_3 = CullIndex(List=subcrv_3, Indices=panel_14, Wrap=True)  # -> simplify(List)
item_18 = ListItem(List=subcrv_3, Index=panel_14, Wrap=True)
pshift_5 = ShiftPaths(Data=cull_i_3, Offset=-1)
flip_5 = FlipMatrix(Data=pshift_5)
midpt_4 = CurveMiddle(Curve=flip_5)
loft_8 = Loft(Curves=cir_3, Options={Adjust=False, Closed=False, LoftEnds=0, LoftSimp=0, LoftType=0, Rebuild=10, Refit=0.01})
pshift_6 = ShiftPaths(Data=item_18, Offset=-1)
graph_6 = GraphMapper(range_8, x0=0, x1=1, y0=0, y1=1, container_name="Bezier", cpx=[0, 0.25, 0.75, 1], cpy=[0, 0.25, 0.75, 1])
join_3 = JoinCurves(Curves=pshift_6, Preserve=False)
brep_cp_3 = BrepClosestPoint(Point=midpt_4, Brep=loft_8)  # -> Point, Normal, Distance
dom_6 = ConstructDomain(DomainStart=Slider(0.1, range=0..10), DomainEnd=Slider(0.11, range=0..1))
flip_6 = FlipMatrix(Data=join_3)
bnd_7 = Bounds(Numbers=graph_6)
remap_6 = RemapNumbers(Value=graph_6, Source=bnd_7, Target=dom_6)  # -> Mapped, Clipped
amp_4 = Amplitude(Vector=brep_cp_3.Normal, Amplitude=remap_6.Mapped)
rev_3 = Reverse(Vector=amp_4)
end_7 = EndPoints(Curve=flip_5)  # -> Start, End
move_9 = Move(Geometry=midpt_4, Motion=rev_3)  # -> Geometry, Transform
arc_3 = Arc3Pt(PointA=end_7.Start, PointB=move_9.Geometry, PointC=end_7.End)  # -> Arc, Plane, Radius
item_19 = ListItem(List=arc_3.Arc, Index=0, Wrap=True)
project_4 = Project(Geometry=item_19, Plane=PlaneXY(0, 0, 0))  # -> Geometry, Transform
loft_opt_3 = LoftOptions(Closed=False, Adjust=False, Rebuild=0, Refit="0.01", Type=0)
replace_3 = ReplaceItems(List=arc_3.Arc, Item=project_4.Geometry, Indices="0", Wrap=False)
loft_9 = Loft(Curves=flip_6, Options=loft_opt_3)
loft_10 = Loft(Curves=replace_3, Options=loft_opt_3)
entwine_8 = Entwine(Branch00=loft_10, Branch01=loft_9, FlattenInputs=True)
merge_11 = Merge(Data1=ColourSwatch(SwatchColor=RGBA(107, 107, 107, 206)), Data2=ColourSwatch(SwatchColor=RGB(255, 255, 255)))  # -> simplify(graft(Result))
python_3 = GhPythonScript(S=entwine_8, D=Slider(0.01, range=0..1))  # -> simplify(a); inputs S: Brep; same code as python
brep_3 = Brep(cap_2)
flatten_4 = FlattenTree(Tree=python_3, Path="{0}")

Z_11 = UnitZ(Factor=expr("-x", Slider(0.1, range=0..10)))
item_20 = ListItem(List=cir_3, Index="-1", Wrap=True)
extr_6 = Extrude(Base=item_20, Direction=Z_11)
cap_6 = CapHoles(Brep=extr_6)

item_21 = ListItem(List=flatten(brep_3), Index=0, Wrap=True)

volume_4 = Volume(Geometry=item_21)  # -> Volume, Centroid
move2pt_5 = MoveToPoint(Geometry=flatten_4, PointA=area_5.Centroid, PointB=graft(volume_4.Centroid))  # -> simplify(Moved), Vector, Transform
lng_3 = ListLength(List=move2pt_5.Moved)
graft_3 = GraftTree(Tree=volume_4.Centroid, IncludeEmptyLists=True, IncludeNullItems=True)  # -> simplify(Tree)
group_3 = Group(Objects=move2pt_5.Moved)
split_6 = SplitList(List=move2pt_5.Moved, Index=expr("x/2", lng_3))  # -> flatten(ListA), flatten(ListB)
mirror_4 = Mirror(Geometry=group_3, Plane=graft_3)  # -> Geometry, Transform
ungroup_3 = Ungroup(Group=mirror_4.Geometry)
move2pt_6 = MoveToPoint(Geometry=cap_6, PointA=area_5.Centroid, PointB=graft(volume_4.Centroid))  # -> Moved, Vector, Transform
entwine_9 = Entwine(Branch00=split_6.ListA, Branch01=split_6.ListB, FlattenInputs=True)  # -> simplify(Result)
split_7 = SplitList(List=ungroup_3, Index=expr("x/2", lng_3))  # -> flatten(ListA), flatten(ListB)
entwine_10 = Entwine(Branch00=split_7.ListA, Branch01=split_7.ListB, FlattenInputs=True)  # -> simplify(Result)
merge_12 = Merge(Data1=entwine_9, Data2=entwine_10)
previewmat_5 = CustomPreviewMaterials(Geometry=merge_12, DiffuseColor=merge_3)
previewmat_6 = CustomPreviewMaterials(Geometry=move2pt_6.Moved, DiffuseColor=RGB(255, 255, 255))

merge_13 = Merge(Data1=move2pt_6.Moved, Data2=merge_12, Data3=move2pt_2.Moved, Data4=merge_4, Data5=move2pt_4.Moved, Data6=merge_9)  # disabled
send = Send(
    Stream=panel_9,
    Data=merge_13,
    AutoSend=False,
    BaseId="7005cf4f04ba1d7dde6e5ba4a54a8704",
    CurrentComponentState="expired",
    KitName="Objects",
    OutputWrappers="https://macad.speckle.xyz\t5e4e4e4563\t1905a1a1a6",
    UseDefaultCache=True,
    selectedKitName="Objects")  # disabled
panel_16 = Panel(send)  # disabled

entwine_11 = Entwine(Branch00=item_11, Branch01=offsrf, Branch02=offset_3, Branch03=offset_4, FlattenInputs=True)
merge_14 = Merge(Data1=ColourSwatch(SwatchColor=RGBA(189, 189, 189, 206)), Data2=ColourSwatch(SwatchColor=RGB(255, 255, 255)))  # -> simplify(graft(Result))
python_4 = GhPythonScript(S=entwine_11, D=Slider(0.01, range=0..1))  # -> simplify(a); inputs S: Brep; same code as python
brep_4 = Brep(item_4)
volume_5 = Volume(Geometry=brep_4)  # -> Volume, Centroid
flatten_5 = FlattenTree(Tree=python_4, Path="{0}")
graft_4 = GraftTree(Tree=volume_5.Centroid, IncludeEmptyLists=True, IncludeNullItems=True)  # -> simplify(Tree)

entwine_12 = Entwine(Branch00=flatten_5, Branch01=entwine_4, FlattenInputs=True)

move2pt_7 = MoveToPoint(Geometry=entwine_12, PointA=area_2.Centroid, PointB=graft(volume_5.Centroid))  # -> simplify(Moved), Vector, Transform
lng_4 = ListLength(List=move2pt_7.Moved)
group_4 = Group(Objects=move2pt_7.Moved)
split_8 = SplitList(List=move2pt_7.Moved, Index=expr("x/2", lng_4))  # -> flatten(ListA), flatten(ListB)
mirror_5 = Mirror(Geometry=group_4, Plane=graft_4)  # -> Geometry, Transform
ungroup_4 = Ungroup(Group=mirror_5.Geometry)
entwine_13 = Entwine(Branch00=split_8.ListA, Branch01=split_8.ListB, FlattenInputs=True)  # -> simplify(Result)
split_9 = SplitList(List=ungroup_4, Index=expr("x/2", lng_4))  # -> flatten(ListA), flatten(ListB)
entwine_14 = Entwine(Branch00=split_9.ListA, Branch01=split_9.ListB, FlattenInputs=True)  # -> simplify(Result)
merge_15 = Merge(Data1=entwine_13, Data2=entwine_14)
previewmat_7 = CustomPreviewMaterials(Geometry=merge_15, DiffuseColor=merge_14)
